# Dynamo graph flower.dyn (Dynamo 3.3.0.6316)

background = CodeBlock()
# ---------- background.designscript (19 lines) ----------
Line.ByStartPointEndPoint(Point.ByCoordinates(-1352.550, 1035.283, 0), Point.ByCoordinates(7007.450, 1035.283, 0));
Line.ByStartPointEndPoint(Point.ByCoordinates(-132.550, 1035.283, 0), Point.ByCoordinates(-132.550, 3535.283, 0));
Line.ByStartPointEndPoint(Point.ByCoordinates(-1352.550, 3535.283, 0), Point.ByCoordinates(7007.450, 3535.283, 0));
Line.ByStartPointEndPoint(Point.ByCoordinates(6287.450, 1035.283, 0), Point.ByCoordinates(6287.450, 3535.283, 0));
Line.ByStartPointEndPoint(Point.ByCoordinates(387.450, 1035.283, 0), Point.ByCoordinates(387.450, 3155.283, 0));
Line.ByStartPointEndPoint(Point.ByCoordinates(387.450, 3155.283, 0), Point.ByCoordinates(1297.450, 3155.283, 0));
Line.ByStartPointEndPoint(Point.ByCoordinates(1297.450, 3155.283, 0), Point.ByCoordinates(1297.450, 1035.283, 0));
Line.ByStartPointEndPoint(Point.ByCoordinates(5967.450, 1035.283, 0), Point.ByCoordinates(5967.450, 3155.283, 0));
Line.ByStartPointEndPoint(Point.ByCoordinates(5967.450, 3155.283, 0), Point.ByCoordinates(5057.450, 3155.283, 0));
Line.ByStartPointEndPoint(Point.ByCoordinates(5057.450, 3155.283, 0), Point.ByCoordinates(5057.450, 1035.283, 0));
Line.ByStartPointEndPoint(Point.ByCoordinates(287.450, 3255.283, 0), Point.ByCoordinates(1397.450, 3255.283, 0));
Line.ByStartPointEndPoint(Point.ByCoordinates(1397.450, 3255.283, 0), Point.ByCoordinates(1397.450, 1035.283, 0));
Line.ByStartPointEndPoint(Point.ByCoordinates(287.450, 1035.283, 0), Point.ByCoordinates(287.450, 3255.283, 0));
Line.ByStartPointEndPoint(Point.ByCoordinates(6067.450, 3255.283, 0), Point.ByCoordinates(4957.450, 3255.283, 0));
Line.ByStartPointEndPoint(Point.ByCoordinates(4957.450, 3255.283, 0), Point.ByCoordinates(4957.450, 1035.283, 0));
Line.ByStartPointEndPoint(Point.ByCoordinates(6067.450, 1035.283, 0), Point.ByCoordinates(6067.450, 3255.283, 0));
Line.ByStartPointEndPoint(Point.ByCoordinates(2809.746, 1323.098, 0), Point.ByCoordinates(3149.746, 1323.098, 0));
Line.ByStartPointEndPoint(Point.ByCoordinates(3149.746, 1323.098, 0), Point.ByCoordinates(3072.626, 1035.283, 0));
Line.ByStartPointEndPoint(Point.ByCoordinates(2809.746, 1323.098, 0), Point.ByCoordinates(2886.866, 1035.283, 0));
# ----------------------------------------
flower_stalk = CodeBlock()
# ---------- flower_stalk.designscript (6 lines) ----------
[   Point.ByCoordinates(2956.961, 1916.914,  0.000),
    Point.ByCoordinates(2875.615, 1613.328, 0.000),
    Point.ByCoordinates(3185.026, 1454.766, 0.000),
    Point.ByCoordinates(2965.344, 1327.932, 0.000)
  ];
  3;
# ----------------------------------------
byControlPoints = NurbsCurve.ByControlPoints(points=flower_stalk.out0, degree=flower_stalk.out1)
flower_face = CodeBlock()
# ---------- flower_face.designscript (3 lines) ----------
Arc.ByCenterPointRadiusAngle(Point.ByCoordinates(2957, 2010, 0), 44, 200, 340, Vector.ZAxis());
Arc.ByCenterPointRadiusAngle(Point.ByCoordinates(2926, 2040, 0), 24, 200, 340, Vector.ZAxis());
Arc.ByCenterPointRadiusAngle(Point.ByCoordinates(2986, 2040, 0), 24, 205, 340, Vector.ZAxis());
# ----------------------------------------
now = DateTime.Now()
components = DateTime.Components(dateTime=now)
python_script = Python(IN[0]=components.second)  # CPython3
# ---------- python_script.python (13 lines) ----------
import sys
import clr
clr.AddReference('ProtoGeometry')
from Autodesk.DesignScript.Geometry import *

import math

sec = IN[0]

options = [10, 0, 50, 20, 40, 0, 30, 30, 70, 60]
index = int(math.floor(sec)) % len(options)

OUT = options[index]
# ----------------------------------------
y_movement = Python(IN[0]=components.second)  # CPython3
# ---------- y_movement.python (14 lines) ----------
import sys
import clr
clr.AddReference('ProtoGeometry')
from Autodesk.DesignScript.Geometry import *

import math

sec = IN[0]

# Predefined shuffled list of allowed values
options = [10, 50, 30, 20, 40, 0, 30, 70, 40, 60]
index = int(math.floor(sec)) % len(options)

OUT = options[index]
# ----------------------------------------
code_block = CodeBlock(n=python_script, p=y_movement)
# ---------- code_block.designscript (44 lines) ----------
[
  [
    Point.ByCoordinates(3000, 1935, 0),
    Point.ByCoordinates(3530 + n, 1730 + p, 0),
    Point.ByCoordinates(3050 + n, 1315 + p, 0),
    Point.ByCoordinates(2975 + n, 1920 + p, 0),
    Point.ByCoordinates(3010, 1935, 0)
  ],
  [
    Point.ByCoordinates(3049, 2010, 0),
    Point.ByCoordinates(3504 + n, 2351 + p, 0),
    Point.ByCoordinates(3601 + n, 1724 + p, 0),
    Point.ByCoordinates(3049 + n, 1981 + p, 0),
    Point.ByCoordinates(3054, 2019, 0)
  ],
  [
    Point.ByCoordinates(3011, 2092, 0),
    Point.ByCoordinates(2963 + n, 2658 + p, 0),
    Point.ByCoordinates(3547 + n, 2408 + p, 0),
    Point.ByCoordinates(3036 + n, 2076 + p, 0),
    Point.ByCoordinates(3007, 2101, 0)
  ],
  [
    Point.ByCoordinates(2922, 2103, 0),
    Point.ByCoordinates(2416 + n, 2362 + p, 0),
    Point.ByCoordinates(2937 + n, 2725 + p, 0),
    Point.ByCoordinates(2949 + n, 2115 + p, 0),
    Point.ByCoordinates(2912, 2104, 0)
  ],
  [
    Point.ByCoordinates(2865, 2033, 0),
    Point.ByCoordinates(2378 + n, 1742 + p, 0),
    Point.ByCoordinates(2346 + n, 2376 + p, 0),
    Point.ByCoordinates(2869 + n, 2062 + p, 0),
    Point.ByCoordinates(2859, 2025, 0)
  ],
  [
    Point.ByCoordinates(2895, 1948, 0),
    Point.ByCoordinates(2883 + n, 1380 + p, 0),
    Point.ByCoordinates(2329 + n, 1689 + p, 0),
    Point.ByCoordinates(2872 + n, 1967 + p, 0),
    Point.ByCoordinates(2898, 1939, 0)
  ]
];
# ----------------------------------------
flower_base_petal = CodeBlock { 3; }
byControlPoints_2 = NurbsCurve.ByControlPoints(points=code_block, degree=flower_base_petal)
code_block_2 = CodeBlock { [0 , 1800]; [40, 1840]; [80, 1880]; [120, 1920]; [160, 1960]; [200, 2000]; }
code_block_3 = CodeBlock(a=code_block_2.out0, b=code_block_2.out1, c=code_block_2.out2, d=code_block_2.out3, e=code_block_2.out4, f=code_block_2.out5)
# ---------- code_block_3.designscript (52 lines) ----------
[
[
    Circle.ByCenterPointRadius(Point.ByCoordinates(1510 + a, 2650 + 250, 0), 50),
    Circle.ByCenterPointRadius(Point.ByCoordinates(1510 + a, 2650 + 250, 0), 30),
    Circle.ByCenterPointRadius(Point.ByCoordinates(1510 + a, 2650 + 250, 0), 10),
    Line.ByStartPointEndPoint(Point.ByCoordinates(1560 + a, 2650 + 250, 0), Point.ByCoordinates(1560 + a, 2900 + 250, 0)),
    Line.ByStartPointEndPoint(Point.ByCoordinates(1560 + a, 2900 + 250, 0), Point.ByCoordinates(1650 + a, 2850 + 250, 0)),
    Line.ByStartPointEndPoint(Point.ByCoordinates(1560 + a, 2850 + 250, 0), Point.ByCoordinates(1650 + a, 2800 + 250, 0))
],
[
    Circle.ByCenterPointRadius(Point.ByCoordinates(1760 + b, 2600 + 250, 0), 50),
    Circle.ByCenterPointRadius(Point.ByCoordinates(1760 + b, 2600 + 250, 0), 30),
    Circle.ByCenterPointRadius(Point.ByCoordinates(1760 + b, 2600 + 250, 0), 10),
    Line.ByStartPointEndPoint(Point.ByCoordinates(1810 + b, 2600 + 250, 0), Point.ByCoordinates(1810 + b, 2850 + 250, 0)),
    Circle.ByCenterPointRadius(Point.ByCoordinates(1900 + b, 2600 + 250, 0), 50),
    Circle.ByCenterPointRadius(Point.ByCoordinates(1900 + b, 2600 + 250, 0), 30),
    Circle.ByCenterPointRadius(Point.ByCoordinates(1900 + b, 2600 + 250, 0), 10),
    Line.ByStartPointEndPoint(Point.ByCoordinates(1950 + b, 2600 + 250, 0), Point.ByCoordinates(1950 + b, 2850 + 250, 0)),
    Line.ByStartPointEndPoint(Point.ByCoordinates(1810 + b, 2850 + 250, 0), Point.ByCoordinates(1950 + b, 2850 + 250, 0))
],
[
    Circle.ByCenterPointRadius(Point.ByCoordinates(2060 + c, 2630 + 250, 0), 50),
    Line.ByStartPointEndPoint(Point.ByCoordinates(2110 + c, 2630 + 250, 0), Point.ByCoordinates(2110 + c, 2880 + 250, 0))
],
[
    Circle.ByCenterPointRadius(Point.ByCoordinates(2310 + d, 2650 + 250, 0), 50),
    Circle.ByCenterPointRadius(Point.ByCoordinates(2310 + d, 2650 + 250, 0), 30),
    Circle.ByCenterPointRadius(Point.ByCoordinates(2310 + d, 2650 + 250, 0), 10),
    Line.ByStartPointEndPoint(Point.ByCoordinates(2360 + d, 2650 + 250, 0), Point.ByCoordinates(2360 + d, 2900 + 250, 0)),
    Line.ByStartPointEndPoint(Point.ByCoordinates(2360 + d, 2900 + 250, 0), Point.ByCoordinates(2450 + d, 2850 + 250, 0)),
    Line.ByStartPointEndPoint(Point.ByCoordinates(2360 + d, 2850 + 250, 0), Point.ByCoordinates(2450 + d, 2800 + 250, 0))
],
[
    Circle.ByCenterPointRadius(Point.ByCoordinates(2560 + e, 2700 + 250, 0), 50),
    Circle.ByCenterPointRadius(Point.ByCoordinates(2560 + e, 2700 + 250, 0), 30),
    Circle.ByCenterPointRadius(Point.ByCoordinates(2560 + e, 2700 + 250, 0), 10),
    Line.ByStartPointEndPoint(Point.ByCoordinates(2610 + e, 2700 + 250, 0), Point.ByCoordinates(2610 + e, 2950 + 250, 0)),
    Line.ByStartPointEndPoint(Point.ByCoordinates(2610 + e, 2950 + 250, 0), Point.ByCoordinates(2700 + e, 2900 + 250, 0)),
    Line.ByStartPointEndPoint(Point.ByCoordinates(2610 + e, 2900 + 250, 0), Point.ByCoordinates(2700 + e, 2850 + 250, 0))
],
[
    Circle.ByCenterPointRadius(Point.ByCoordinates(2810 + f, 2600 + 250, 0), 50),
    Circle.ByCenterPointRadius(Point.ByCoordinates(2810 + f, 2600 + 250, 0), 30),
    Circle.ByCenterPointRadius(Point.ByCoordinates(2810 + f, 2600 + 250, 0), 10),
    Line.ByStartPointEndPoint(Point.ByCoordinates(2860 + f, 2600 + 250, 0), Point.ByCoordinates(2860 + f, 2850 + 250, 0)),
    Circle.ByCenterPointRadius(Point.ByCoordinates(2950 + f, 2600 + 250, 0), 50),
    Circle.ByCenterPointRadius(Point.ByCoordinates(2950 + f, 2600 + 250, 0), 30),
    Circle.ByCenterPointRadius(Point.ByCoordinates(2950 + f, 2600 + 250, 0), 10),
    Line.ByStartPointEndPoint(Point.ByCoordinates(3000 + f, 2600 + 250, 0), Point.ByCoordinates(3000 + f, 2850 + 250, 0)),
    Line.ByStartPointEndPoint(Point.ByCoordinates(2860 + f, 2850 + 250, 0), Point.ByCoordinates(3000 + f, 2850 + 250, 0))
]
];
# ----------------------------------------
code_block_4 = CodeBlock()
# ---------- code_block_4.designscript (87 lines) ----------
Circle.ByCenterPointRadius(Point.ByCoordinates(1510, 2650, 0), 50);
Circle.ByCenterPointRadius(Point.ByCoordinates(1510, 2650, 0), 30);
Circle.ByCenterPointRadius(Point.ByCoordinates(1510, 2650, 0), 10);
Line.ByStartPointEndPoint(Point.ByCoordinates(1560, 2650, 0), Point.ByCoordinates(1560, 2900, 0));
Line.ByStartPointEndPoint(Point.ByCoordinates(1560, 2900, 0), Point.ByCoordinates(1650, 2850, 0));
Line.ByStartPointEndPoint(Point.ByCoordinates(1560, 2850, 0), Point.ByCoordinates(1650, 2800, 0));

Circle.ByCenterPointRadius(Point.ByCoordinates(1760, 2600, 0), 50);
Circle.ByCenterPointRadius(Point.ByCoordinates(1760, 2600, 0), 30);
Circle.ByCenterPointRadius(Point.ByCoordinates(1760, 2600, 0), 10);
Line.ByStartPointEndPoint(Point.ByCoordinates(1810, 2600, 0), Point.ByCoordinates(1810, 2850, 0));
Circle.ByCenterPointRadius(Point.ByCoordinates(1900, 2600, 0), 50);
Circle.ByCenterPointRadius(Point.ByCoordinates(1900, 2600, 0), 30);
Circle.ByCenterPointRadius(Point.ByCoordinates(1900, 2600, 0), 10);
Line.ByStartPointEndPoint(Point.ByCoordinates(1950, 2600, 0), Point.ByCoordinates(1950, 2850, 0));
Line.ByStartPointEndPoint(Point.ByCoordinates(1810, 2850, 0), Point.ByCoordinates(1950, 2850, 0));

Circle.ByCenterPointRadius(Point.ByCoordinates(2060, 2630, 0), 50);
Line.ByStartPointEndPoint(Point.ByCoordinates(2110, 2630, 0), Point.ByCoordinates(2110, 2880, 0));

Circle.ByCenterPointRadius(Point.ByCoordinates(2310, 2650, 0), 50);
Circle.ByCenterPointRadius(Point.ByCoordinates(2310, 2650, 0), 30);
Circle.ByCenterPointRadius(Point.ByCoordinates(2310, 2650, 0), 10);
Line.ByStartPointEndPoint(Point.ByCoordinates(2360, 2650, 0), Point.ByCoordinates(2360, 2900, 0));
Line.ByStartPointEndPoint(Point.ByCoordinates(2360, 2900, 0), Point.ByCoordinates(2450, 2850, 0));
Line.ByStartPointEndPoint(Point.ByCoordinates(2360, 2850, 0), Point.ByCoordinates(2450, 2800, 0));

Circle.ByCenterPointRadius(Point.ByCoordinates(2560, 2700, 0), 50);
Circle.ByCenterPointRadius(Point.ByCoordinates(2560, 2700, 0), 30);
Circle.ByCenterPointRadius(Point.ByCoordinates(2560, 2700, 0), 10);
Line.ByStartPointEndPoint(Point.ByCoordinates(2610, 2700, 0), Point.ByCoordinates(2610, 2950, 0));
Line.ByStartPointEndPoint(Point.ByCoordinates(2610, 2950, 0), Point.ByCoordinates(2700, 2900, 0));
Line.ByStartPointEndPoint(Point.ByCoordinates(2610, 2900, 0), Point.ByCoordinates(2700, 2850, 0));

Circle.ByCenterPointRadius(Point.ByCoordinates(2810, 2600, 0), 50);
Circle.ByCenterPointRadius(Point.ByCoordinates(2810, 2600, 0), 30);
Circle.ByCenterPointRadius(Point.ByCoordinates(2810, 2600, 0), 10);
Line.ByStartPointEndPoint(Point.ByCoordinates(2860, 2600, 0), Point.ByCoordinates(2860, 2850, 0));
Circle.ByCenterPointRadius(Point.ByCoordinates(2950, 2600, 0), 50);
Circle.ByCenterPointRadius(Point.ByCoordinates(2950, 2600, 0), 30);
Circle.ByCenterPointRadius(Point.ByCoordinates(2950, 2600, 0), 10);
Line.ByStartPointEndPoint(Point.ByCoordinates(3000, 2600, 0), Point.ByCoordinates(3000, 2850, 0));
Line.ByStartPointEndPoint(Point.ByCoordinates(2860, 2850, 0), Point.ByCoordinates(3000, 2850, 0));

Circle.ByCenterPointRadius(Point.ByCoordinates(3310, 2700, 0), 50);
Circle.ByCenterPointRadius(Point.ByCoordinates(3310, 2700, 0), 30);
Circle.ByCenterPointRadius(Point.ByCoordinates(3310, 2700, 0), 10);
Line.ByStartPointEndPoint(Point.ByCoordinates(3360, 2700, 0), Point.ByCoordinates(3360, 2950, 0));
Line.ByStartPointEndPoint(Point.ByCoordinates(3360, 2950, 0), Point.ByCoordinates(3450, 2900, 0));
Line.ByStartPointEndPoint(Point.ByCoordinates(3360, 2900, 0), Point.ByCoordinates(3450, 2850, 0));

Circle.ByCenterPointRadius(Point.ByCoordinates(3560, 2650, 0), 50);
Circle.ByCenterPointRadius(Point.ByCoordinates(3560, 2650, 0), 30);
Circle.ByCenterPointRadius(Point.ByCoordinates(3560, 2650, 0), 10);
Line.ByStartPointEndPoint(Point.ByCoordinates(3610, 2650, 0), Point.ByCoordinates(3610, 2900, 0));
Circle.ByCenterPointRadius(Point.ByCoordinates(3700, 2650, 0), 50);
Circle.ByCenterPointRadius(Point.ByCoordinates(3700, 2650, 0), 30);
Circle.ByCenterPointRadius(Point.ByCoordinates(3700, 2650, 0), 10);
Line.ByStartPointEndPoint(Point.ByCoordinates(3750, 2650, 0), Point.ByCoordinates(3750, 2900, 0));
Line.ByStartPointEndPoint(Point.ByCoordinates(3610, 2900, 0), Point.ByCoordinates(3750, 2900, 0));

Circle.ByCenterPointRadius(Point.ByCoordinates(3860, 2680, 0), 50);
Line.ByStartPointEndPoint(Point.ByCoordinates(3910, 2680, 0), Point.ByCoordinates(3910, 2930, 0));

Circle.ByCenterPointRadius(Point.ByCoordinates(4110, 2700, 0), 50);
Circle.ByCenterPointRadius(Point.ByCoordinates(4110, 2700, 0), 30);
Circle.ByCenterPointRadius(Point.ByCoordinates(4110, 2700, 0), 10);
Line.ByStartPointEndPoint(Point.ByCoordinates(4160, 2700, 0), Point.ByCoordinates(4160, 2950, 0));
Line.ByStartPointEndPoint(Point.ByCoordinates(4160, 2950, 0), Point.ByCoordinates(4250, 2900, 0));
Line.ByStartPointEndPoint(Point.ByCoordinates(4160, 2900, 0), Point.ByCoordinates(4250, 2850, 0));

Circle.ByCenterPointRadius(Point.ByCoordinates(4360, 2750, 0), 50);
Circle.ByCenterPointRadius(Point.ByCoordinates(4360, 2750, 0), 30);
Circle.ByCenterPointRadius(Point.ByCoordinates(4360, 2750, 0), 10);
Line.ByStartPointEndPoint(Point.ByCoordinates(4410, 2750, 0), Point.ByCoordinates(4410, 3000, 0));
Line.ByStartPointEndPoint(Point.ByCoordinates(4410, 3000, 0), Point.ByCoordinates(4500, 2950, 0));
Line.ByStartPointEndPoint(Point.ByCoordinates(4410, 2950, 0), Point.ByCoordinates(4500, 2900, 0));

Circle.ByCenterPointRadius(Point.ByCoordinates(4610, 2650, 0), 50);
Circle.ByCenterPointRadius(Point.ByCoordinates(4610, 2650, 0), 30);
Circle.ByCenterPointRadius(Point.ByCoordinates(4610, 2650, 0), 10);
Line.ByStartPointEndPoint(Point.ByCoordinates(4660, 2650, 0), Point.ByCoordinates(4660, 2900, 0));
Circle.ByCenterPointRadius(Point.ByCoordinates(4750, 2650, 0), 50);
Circle.ByCenterPointRadius(Point.ByCoordinates(4750, 2650, 0), 30);
Circle.ByCenterPointRadius(Point.ByCoordinates(4750, 2650, 0), 10);
Line.ByStartPointEndPoint(Point.ByCoordinates(4800, 2650, 0), Point.ByCoordinates(4800, 2900, 0));
Line.ByStartPointEndPoint(Point.ByCoordinates(4660, 2900, 0), Point.ByCoordinates(4800, 2900, 0));
# ----------------------------------------
code_block_5 = CodeBlock(i=components.second) { i; }
python_script_2 = Python(IN[1]=code_block_5)  # CPython3; unwired: IN[0]
# ---------- python_script_2.python (35 lines) ----------
import clr
clr.AddReference('ProtoGeometry')
from Autodesk.DesignScript.Geometry import *
import math

# === INPUTS ===
notes = IN[0]  # List of 6 note groups
sec = IN[1]    # Time in seconds
step = 300     # Shift step in X 
interval = 5   # Time between shifts

# Total 12 notes: original + duplicated, shifted right by 1800
all_notes = notes + [
    [g.Translate(Vector.ByCoordinates(1800, 0, 0)) for g in n]
    for n in notes
]

# Compute how many shifts have occurred
shift_count = int(math.floor(sec / interval))
x_shift = -shift_count * step

# Build visible groups, omitting the one on the left
moved_notes = []

for i in range(12):
    index = (i + shift_count) % 12
    if i == 0:
        continue  # Skip the one on the far left (about to vanish)
    note_group = all_notes[index]
    translated_group = [
        g.Translate(Vector.ByCoordinates(x_shift, 0, 0)) for g in note_group
    ]
    moved_notes.append(translated_group)

OUT = moved_notes
# ----------------------------------------
code_block_6 = CodeBlock(i=python_script_2) { i; }
code_block_7 = CodeBlock { 1800; }
translate = Geometry.Translate(xTranslation=code_block_7)  # unwired: geometry
