# Dynamo graph flower2.dyn (Dynamo 3.3.0.6316)

# group: Background
background = CodeBlock()
# ---------- background.designscript (19 lines) ----------
Line.ByStartPointEndPoint(Point.ByCoordinates(-1352.550, 1035.283, 0), Point.ByCoordinates(7007.450, 1035.283, 0));
Line.ByStartPointEndPoint(Point.ByCoordinates(-132.550, 1035.283, 0), Point.ByCoordinates(-132.550, 3535.283, 0));
Line.ByStartPointEndPoint(Point.ByCoordinates(-1352.550, 3535.283, 0), Point.ByCoordinates(7007.450, 3535.283, 0));
Line.ByStartPointEndPoint(Point.ByCoordinates(6287.450, 1035.283, 0), Point.ByCoordinates(6287.450, 3535.283, 0));
Line.ByStartPointEndPoint(Point.ByCoordinates(387.450, 1035.283, 0), Point.ByCoordinates(387.450, 3155.283, 0));
Line.ByStartPointEndPoint(Point.ByCoordinates(387.450, 3155.283, 0), Point.ByCoordinates(1297.450, 3155.283, 0));
Line.ByStartPointEndPoint(Point.ByCoordinates(1297.450, 3155.283, 0), Point.ByCoordinates(1297.450, 1035.283, 0));
Line.ByStartPointEndPoint(Point.ByCoordinates(5967.450, 1035.283, 0), Point.ByCoordinates(5967.450, 3155.283, 0));
Line.ByStartPointEndPoint(Point.ByCoordinates(5967.450, 3155.283, 0), Point.ByCoordinates(5057.450, 3155.283, 0));
Line.ByStartPointEndPoint(Point.ByCoordinates(5057.450, 3155.283, 0), Point.ByCoordinates(5057.450, 1035.283, 0));
Line.ByStartPointEndPoint(Point.ByCoordinates(287.450, 3255.283, 0), Point.ByCoordinates(1397.450, 3255.283, 0));
Line.ByStartPointEndPoint(Point.ByCoordinates(1397.450, 3255.283, 0), Point.ByCoordinates(1397.450, 1035.283, 0));
Line.ByStartPointEndPoint(Point.ByCoordinates(287.450, 1035.283, 0), Point.ByCoordinates(287.450, 3255.283, 0));
Line.ByStartPointEndPoint(Point.ByCoordinates(6067.450, 3255.283, 0), Point.ByCoordinates(4957.450, 3255.283, 0));
Line.ByStartPointEndPoint(Point.ByCoordinates(4957.450, 3255.283, 0), Point.ByCoordinates(4957.450, 1035.283, 0));
Line.ByStartPointEndPoint(Point.ByCoordinates(6067.450, 1035.283, 0), Point.ByCoordinates(6067.450, 3255.283, 0));
Line.ByStartPointEndPoint(Point.ByCoordinates(2809.746, 1323.098, 0), Point.ByCoordinates(3149.746, 1323.098, 0));
Line.ByStartPointEndPoint(Point.ByCoordinates(3149.746, 1323.098, 0), Point.ByCoordinates(3072.626, 1035.283, 0));
Line.ByStartPointEndPoint(Point.ByCoordinates(2809.746, 1323.098, 0), Point.ByCoordinates(2886.866, 1035.283, 0));
# ----------------------------------------
flower_stalk = CodeBlock()
# ---------- flower_stalk.designscript (6 lines) ----------
[   Point.ByCoordinates(2956.961, 1916.914,  0.000),
    Point.ByCoordinates(2875.615, 1613.328, 0.000),
    Point.ByCoordinates(3185.026, 1454.766, 0.000),
    Point.ByCoordinates(2965.344, 1327.932, 0.000)
  ];
  3;
# ----------------------------------------
byControlPoints = NurbsCurve.ByControlPoints(points=flower_stalk.out0, degree=flower_stalk.out1)
flower_face = CodeBlock()
# ---------- flower_face.designscript (3 lines) ----------
Arc.ByCenterPointRadiusAngle(Point.ByCoordinates(2957, 2010, 0), 44, 200, 340, Vector.ZAxis());
Arc.ByCenterPointRadiusAngle(Point.ByCoordinates(2926, 2040, 0), 24, 200, 340, Vector.ZAxis());
Arc.ByCenterPointRadiusAngle(Point.ByCoordinates(2986, 2040, 0), 24, 205, 340, Vector.ZAxis());
# ----------------------------------------

# group: TIME
now = DateTime.Now()
components = DateTime.Components(dateTime=now)

# group: Petals
x_movement = Python(IN[0]=components.second)  # CPython3
# ---------- x_movement.python (13 lines) ----------
import sys
import clr
clr.AddReference('ProtoGeometry')
from Autodesk.DesignScript.Geometry import *

import math

sec = IN[0]

options = [10, 0, 50, 20, 40, 0, 30, 30, 70, 60]
index = int(math.floor(sec)) % len(options)

OUT = options[index]
# ----------------------------------------
y_movement = Python(IN[0]=components.second)  # CPython3
# ---------- y_movement.python (14 lines) ----------
import sys
import clr
clr.AddReference('ProtoGeometry')
from Autodesk.DesignScript.Geometry import *

import math

sec = IN[0]

# Predefined shuffled list of allowed values
options = [10, 50, 30, 20, 40, 0, 30, 70, 40, 60]
index = int(math.floor(sec)) % len(options)

OUT = options[index]
# ----------------------------------------
code_block = CodeBlock(n=x_movement, p=y_movement)
# ---------- code_block.designscript (44 lines) ----------
[
  [
    Point.ByCoordinates(3000, 1935, 0),
    Point.ByCoordinates(3530 + n, 1730 + p, 0),
    Point.ByCoordinates(3050 + n, 1315 + p, 0),
    Point.ByCoordinates(2975 + n, 1920 + p, 0),
    Point.ByCoordinates(3010, 1935, 0)
  ],
  [
    Point.ByCoordinates(3049, 2010, 0),
    Point.ByCoordinates(3504 + n, 2351 + p, 0),
    Point.ByCoordinates(3601 + n, 1724 + p, 0),
    Point.ByCoordinates(3049 + n, 1981 + p, 0),
    Point.ByCoordinates(3054, 2019, 0)
  ],
  [
    Point.ByCoordinates(3011, 2092, 0),
    Point.ByCoordinates(2963 + n, 2658 + p, 0),
    Point.ByCoordinates(3547 + n, 2408 + p, 0),
    Point.ByCoordinates(3036 + n, 2076 + p, 0),
    Point.ByCoordinates(3007, 2101, 0)
  ],
  [
    Point.ByCoordinates(2922, 2103, 0),
    Point.ByCoordinates(2416 + n, 2362 + p, 0),
    Point.ByCoordinates(2937 + n, 2725 + p, 0),
    Point.ByCoordinates(2949 + n, 2115 + p, 0),
    Point.ByCoordinates(2912, 2104, 0)
  ],
  [
    Point.ByCoordinates(2865, 2033, 0),
    Point.ByCoordinates(2378 + n, 1742 + p, 0),
    Point.ByCoordinates(2346 + n, 2376 + p, 0),
    Point.ByCoordinates(2869 + n, 2062 + p, 0),
    Point.ByCoordinates(2859, 2025, 0)
  ],
  [
    Point.ByCoordinates(2895, 1948, 0),
    Point.ByCoordinates(2883 + n, 1380 + p, 0),
    Point.ByCoordinates(2329 + n, 1689 + p, 0),
    Point.ByCoordinates(2872 + n, 1967 + p, 0),
    Point.ByCoordinates(2898, 1939, 0)
  ]
];
# ----------------------------------------
flower_base_petal = CodeBlock { 3; }
byControlPoints_2 = NurbsCurve.ByControlPoints(points=code_block, degree=flower_base_petal)

# group: Music
code_block_2 = CodeBlock()
# ---------- code_block_2.designscript (45 lines) ----------
[[
    Circle.ByCenterPointRadius(Point.ByCoordinates(0, 0, 0), 50),
    Circle.ByCenterPointRadius(Point.ByCoordinates(0, 0, 0), 30),
    Circle.ByCenterPointRadius(Point.ByCoordinates(0, 0, 0), 10),
    Line.ByStartPointEndPoint(Point.ByCoordinates(50, 0, 0), Point.ByCoordinates(50, 250, 0)),
    Line.ByStartPointEndPoint(Point.ByCoordinates(50, 250, 0), Point.ByCoordinates(150, 200, 0)),
    Line.ByStartPointEndPoint(Point.ByCoordinates(50, 200, 0), Point.ByCoordinates(150, 150, 0))
], [
    Circle.ByCenterPointRadius(Point.ByCoordinates(0, 0, 0), 50),
    Circle.ByCenterPointRadius(Point.ByCoordinates(0, 0, 0), 30),
    Circle.ByCenterPointRadius(Point.ByCoordinates(0, 0, 0), 10),
    Line.ByStartPointEndPoint(Point.ByCoordinates(50, 0, 0), Point.ByCoordinates(50, 250, 0)),
    Circle.ByCenterPointRadius(Point.ByCoordinates(140, 0, 0), 50),
    Circle.ByCenterPointRadius(Point.ByCoordinates(140, 0, 0), 30),
    Circle.ByCenterPointRadius(Point.ByCoordinates(140, 0, 0), 10),
    Line.ByStartPointEndPoint(Point.ByCoordinates(190, 0, 0), Point.ByCoordinates(190, 250, 0)),
    Line.ByStartPointEndPoint(Point.ByCoordinates(50, 250, 0), Point.ByCoordinates(190, 250, 0))
], [
    Circle.ByCenterPointRadius(Point.ByCoordinates(0, 0, 0), 50),
    Line.ByStartPointEndPoint(Point.ByCoordinates(50, 0, 0), Point.ByCoordinates(50, 250, 0))
], [
    Circle.ByCenterPointRadius(Point.ByCoordinates(0, 0, 0), 50),
    Circle.ByCenterPointRadius(Point.ByCoordinates(0, 0, 0), 30),
    Circle.ByCenterPointRadius(Point.ByCoordinates(0, 0, 0), 10),
    Line.ByStartPointEndPoint(Point.ByCoordinates(50, 0, 0), Point.ByCoordinates(50, 250, 0)),
    Line.ByStartPointEndPoint(Point.ByCoordinates(50, 250, 0), Point.ByCoordinates(140, 200, 0)),
    Line.ByStartPointEndPoint(Point.ByCoordinates(50, 200, 0), Point.ByCoordinates(140, 150, 0))
], [
    Circle.ByCenterPointRadius(Point.ByCoordinates(0, 0, 0), 50),
    Circle.ByCenterPointRadius(Point.ByCoordinates(0, 0, 0), 30),
    Circle.ByCenterPointRadius(Point.ByCoordinates(0, 0, 0), 10),
    Line.ByStartPointEndPoint(Point.ByCoordinates(50, 0, 0), Point.ByCoordinates(50, 250, 0)),
    Line.ByStartPointEndPoint(Point.ByCoordinates(50, 250, 0), Point.ByCoordinates(140, 200, 0)),
    Line.ByStartPointEndPoint(Point.ByCoordinates(50, 200, 0), Point.ByCoordinates(140, 150, 0))
], [
    Circle.ByCenterPointRadius(Point.ByCoordinates(0, 0, 0), 50),
    Circle.ByCenterPointRadius(Point.ByCoordinates(0, 0, 0), 30),
    Circle.ByCenterPointRadius(Point.ByCoordinates(0, 0, 0), 10),
    Line.ByStartPointEndPoint(Point.ByCoordinates(50, 0, 0), Point.ByCoordinates(50, 250, 0)),
    Circle.ByCenterPointRadius(Point.ByCoordinates(140, 0, 0), 50),
    Circle.ByCenterPointRadius(Point.ByCoordinates(140, 0, 0), 30),
    Circle.ByCenterPointRadius(Point.ByCoordinates(140, 0, 0), 10),
    Line.ByStartPointEndPoint(Point.ByCoordinates(190, 0, 0), Point.ByCoordinates(190, 250, 0)),
    Line.ByStartPointEndPoint(Point.ByCoordinates(50, 250, 0), Point.ByCoordinates(190, 250, 0))
]];
# ----------------------------------------
code_block_3 = CodeBlock()
# ---------- code_block_3.designscript (15 lines) ----------
[
    [Vector.ByCoordinates(800, 2500, 0),
    Vector.ByCoordinates(1050, 2700, 0),
    Vector.ByCoordinates(1550, 2800, 0),
    Vector.ByCoordinates(1900, 2700, 0),
    Vector.ByCoordinates(2200, 2800, 0),
    Vector.ByCoordinates(2500, 2881, 0)]
    ,
    [Vector.ByCoordinates(2850, 2838, 0),
    Vector.ByCoordinates(3250, 2711, 0),
    Vector.ByCoordinates(3650, 2677, 0),
    Vector.ByCoordinates(4050, 2849, 0),
    Vector.ByCoordinates(4550, 2945, 0),
    Vector.ByCoordinates(5000, 2800, 0)]
];
# ----------------------------------------
code_block_4 = CodeBlock { 0..5; }
code_block_5 = CodeBlock(sec=components.second) { index = Math.Floor(sec / 2) % 6; }
getItemAtIndex = List.GetItemAtIndex(list=code_block_4, index=code_block_5)
shiftIndices = List.ShiftIndices(list=code_block_3@L2, amount=getItemAtIndex)
code_block_6 = CodeBlock()
# ---------- code_block_6.designscript (15 lines) ----------
distances = [
    [2650,
    3050,
    3200,
    3200,
    3500,
    3800]
    ,
    [4050,
    4250,
    4550,
    4950,
    5420,
    5500]
];
# ----------------------------------------
shiftIndices_2 = List.ShiftIndices(list=code_block_6@L2, amount=getItemAtIndex)
translate = Geometry.Translate(geometry=code_block_2, direction=shiftIndices@L2, distance=shiftIndices_2@L2)
